# Dynamo graph Create_dimStructuralFraming.dyn (Dynamo 2.16.2.5624)
# packages: Genius Loci 2024.2.26

# note: Custom Node: GeniusLociv.2024.2.26
dimension_byreferences = Custom[Dimension ByReferences]()  # package Genius Loci; Creates a new linear dimension from at least two geometric references of an object.; unwired: line, references
select_model_elements_by = DSModelElementsByCategorySelection("OST_StructuralFraming")  # "Select Model Elements By Category"; 2 picked in the model
element_locationcurve = Custom[Element LocationCurve](element=select_model_elements_by)  # package Genius Loci; Gets the curve geometry from the element.
code_block = CodeBlock { 3; }
translate = Geometry.Translate(geometry=element_locationcurve, yTranslation=code_block)
element_points_references = Custom[Element Points References](linearElement=select_model_elements_by)  # package Genius Loci; Returns the references to the start and the end points of the curve based element. (Works best with coarse detail level for cable trays and conduits categories)
dimension_byreferences_2 = Custom[Dimension ByReferences](line=translate, references=element_points_references.References)
